# Dynamo graph test 2.dyn (Dynamo 2.13.1.3887)

origin = Point.Origin()
code_block = CodeBlock { 400000; }
byCenterPointRadius = Circle.ByCenterPointRadius(centerPoint=origin, radius=code_block)
byPatch = Surface.ByPatch(closedCurve=byCenterPointRadius)
categories = Categories("OST_Roofs")
all_elements_of_category = ElementsOfCategory(Category=categories)
geometry = Element.Geometry(element=all_elements_of_category)
explode = Geometry.Explode(geometry=geometry)
faces = Topology.Faces(topology=explode)
code_block_2 = CodeBlock { 1; }
flatten = List.Flatten(list=faces, amount=code_block_2)
edges = Face.Edges(face=flatten)
curveGeometry = Edge.CurveGeometry(edge=edges)
code_block_3 = CodeBlock { 1; }
flatten_2 = List.Flatten(list=curveGeometry, amount=code_block_3)
ZAxis = Vector.ZAxis()
reverse = Vector.Reverse(vector=ZAxis)
projectInputOnto = Surface.ProjectInputOnto(surface=byPatch, geometryToProject=flatten_2, projectionDirection=reverse)
watch = Watch(projectInputOnto)
flatten_3 = List.Flatten()  # unwired: list
map = List.Map(list=watch, function=flatten_3)
code_block_4 = CodeBlock { 1; }
getItemAtIndex = List.GetItemAtIndex(list=map, index=code_block_4)
byJoinedCurves = PolyCurve.ByJoinedCurves(curves=getItemAtIndex)
byPatch_2 = Surface.ByPatch(closedCurve=byJoinedCurves)
code_block_5 = CodeBlock { 10000; }
thicken = Surface.Thicken(surface=byPatch_2, thickness=code_block_5)
code_block_6 = CodeBlock { 7; }
getItemAtIndex_2 = List.GetItemAtIndex(list=map, index=code_block_6)
byJoinedCurves_2 = PolyCurve.ByJoinedCurves(curves=getItemAtIndex_2)
byPatch_3 = Surface.ByPatch(closedCurve=byJoinedCurves_2)
code_block_7 = CodeBlock { 10000; }
thicken_2 = Surface.Thicken(surface=byPatch_3, thickness=code_block_7)
list_create = List.Create(item0=thicken, item1=thicken_2)
byUnion = Solid.ByUnion(solids=list_create)
intersect = Geometry.Intersect(geometry=byUnion, other=byPatch)
area = Surface.Area(surface=intersect)
code_block_8 = CodeBlock { 10000; }
div = area / code_block_8
string = StringInput("")  # graph input
