# Dynamo graph test 21032023.dyn (Dynamo 2.13.1.3887)

categories = Categories("OST_Roofs")
all_elements_of_category = ElementsOfCategory(Category=categories)
getMaterials = Element.GetMaterials(element=all_elements_of_category)
flatten = List.Flatten(list=getMaterials)
uniqueItems = List.UniqueItems(list=flatten)
name = Element.Name(element=uniqueItems)
watch = Watch(name)
string = StringInput("Slope")
getParameterValueByName = Element.GetParameterValueByName(element=all_elements_of_category, parameterName=string)
watch_2 = Watch(getParameterValueByName)
parameters = Element.Parameters(element=all_elements_of_category)
watch_3 = Watch(parameters)
element_classes = ElementTypes("RoofType")
all_elements_of_class = ElementsOfType(element_class=element_classes)
watch_4 = Watch(all_elements_of_class)
categories_2 = Categories("OST_Floors")
all_elements_of_category_2 = ElementsOfCategory(Category=categories_2)
geometry = Element.Geometry(element=all_elements_of_category_2)
flatten_2 = List.Flatten(list=geometry)
byOriginNormal = Plane.ByOriginNormal()
intersect = Geometry.Intersect(geometry=flatten_2, other=byOriginNormal)
flatten_3 = List.Flatten(list=intersect)
area = Surface.Area(surface=flatten_3)
sum = Math.Sum(values=area)
code_block = CodeBlock { 1000000; }
div = sum / code_block
watch_5 = Watch(div)
categories_3 = Categories("OST_Walls")
all_elements_of_category_3 = ElementsOfCategory(Category=categories_3)
geometry_2 = Element.Geometry(element=all_elements_of_category_3)
flatten_4 = List.Flatten(list=geometry_2)
byOriginNormal_2 = Plane.ByOriginNormal()
intersect_2 = Geometry.Intersect(geometry=flatten_4, other=byOriginNormal_2)
flatten_5 = List.Flatten(list=intersect_2)
area_2 = Surface.Area(surface=flatten_5)
sum_2 = Math.Sum(values=area_2)
code_block_2 = CodeBlock { 1000000; }
div_2 = sum_2 / code_block_2
watch_6 = Watch(div_2)
byOriginNormal_3 = Plane.ByOriginNormal()
project = Curve.Project()  # unwired: curve, baseGeometry, projectionDirection
explode = Geometry.Explode(geometry=flatten_2)
perimeterCurves = Surface.PerimeterCurves(surface=explode)
flatten_6 = List.Flatten(list=perimeterCurves)
