# Dynamo graph Get parameters.dyn (Dynamo 2.13.1.3887)

are_all_the_roofs_modelled_as_a = BoolSelector(true)  # "Are all the roofs modelled as a roof?"; graph input

# group: Select green roofs
categories = Categories("OST_Roofs")
all_elements_of_category = ElementsOfCategory(Category=categories)
select_greenroofs = DSModelElementsSelection()  # 1 picked in the model; graph input
if_ = RefactoredIf(test=are_all_the_roofs_modelled_as_a, true=all_elements_of_category, false=select_greenroofs)
getMaterials = Element.GetMaterials(element=if_)
name = Material.Name(material=getMaterials)
green_roof_material = StringInput("UG_Substraatlaag")  # graph input
contains = String.Contains(string=name, searchFor=green_roof_material)
anyTrue = List.AnyTrue(list=contains@L2)
filterByBoolMask = List.FilterByBoolMask(list=if_, mask=anyTrue)

# group: Projected Roof Area
origin = Point.Origin()
code_block = CodeBlock { 900000; }
byCenterPointRadius = Circle.ByCenterPointRadius(centerPoint=origin, radius=code_block)
byPatch = Surface.ByPatch(closedCurve=byCenterPointRadius)
geometry = Element.Geometry(element=filterByBoolMask.in)
explode = Geometry.Explode(geometry=geometry)
faces = Topology.Faces(topology=explode)
code_block_2 = CodeBlock { 1; }
flatten = List.Flatten(list=faces, amount=code_block_2)
edges = Face.Edges(face=flatten)
curveGeometry = Edge.CurveGeometry(edge=edges)
code_block_3 = CodeBlock { 1; }
flatten_2 = List.Flatten(list=curveGeometry, amount=code_block_3)
ZAxis = Vector.ZAxis()
reverse = Vector.Reverse(vector=ZAxis)
projectInputOnto = Surface.ProjectInputOnto(surface=byPatch, geometryToProject=flatten_2, projectionDirection=reverse)
flatten_3 = List.Flatten()  # unwired: list
map = List.Map(list=projectInputOnto, function=flatten_3)
code_block_4 = CodeBlock { null; }
eq = map == code_block_4
anyTrue_2 = List.AnyTrue(list=eq, lacing=CrossProduct)
not_ = Not(x=anyTrue_2)
filterByBoolMask_2 = List.FilterByBoolMask(list=map, mask=not_)
byJoinedCurves = PolyCurve.ByJoinedCurves(curves=filterByBoolMask_2.in)
byPatch_2 = Surface.ByPatch(closedCurve=byJoinedCurves)
thicken = Surface.Thicken(surface=byPatch_2)
byUnion = Solid.ByUnion(solids=thicken)
intersect = Geometry.Intersect(geometry=byUnion, other=byPatch)
area = Surface.Area(surface=intersect)
cm²_m² = CodeBlock { 10000; }
div = area / cm²_m²
sum = Math.Sum(values=div)
code_block_5 = CodeBlock { 1; }

# group: Select roofs
categories_2 = Categories("OST_Roofs")
all_elements_of_category_2 = ElementsOfCategory(Category=categories_2)
select_roofs = DSModelElementsSelection()  # nothing selected; graph input
if_2 = RefactoredIf(test=are_all_the_roofs_modelled_as_a, true=all_elements_of_category_2, false=select_roofs)

# group: Projected Roof Area
code_block_6 = CodeBlock { 1; }
origin_2 = Point.Origin()
code_block_7 = CodeBlock { 400000; }
byCenterPointRadius_2 = Circle.ByCenterPointRadius(centerPoint=origin_2, radius=code_block_7)
byPatch_3 = Surface.ByPatch(closedCurve=byCenterPointRadius_2)
geometry_2 = Element.Geometry(element=if_2)
explode_2 = Geometry.Explode(geometry=geometry_2)
faces_2 = Topology.Faces(topology=explode_2)
code_block_8 = CodeBlock { 1; }
flatten_4 = List.Flatten(list=faces_2, amount=code_block_8)
edges_2 = Face.Edges(face=flatten_4)
curveGeometry_2 = Edge.CurveGeometry(edge=edges_2)
code_block_9 = CodeBlock { 1; }
flatten_5 = List.Flatten(list=curveGeometry_2, amount=code_block_9)
ZAxis_2 = Vector.ZAxis()
reverse_2 = Vector.Reverse(vector=ZAxis_2)
projectInputOnto_2 = Surface.ProjectInputOnto(surface=byPatch_3, geometryToProject=flatten_5, projectionDirection=reverse_2)
flatten_6 = List.Flatten()  # unwired: list
map_2 = List.Map(list=projectInputOnto_2, function=flatten_6)
code_block_10 = CodeBlock { null; }
eq_2 = map_2 == code_block_10
anyTrue_3 = List.AnyTrue(list=eq_2, lacing=CrossProduct)
not_2 = Not(x=anyTrue_3)
filterByBoolMask_3 = List.FilterByBoolMask(list=map_2, mask=not_2)
byJoinedCurves_2 = PolyCurve.ByJoinedCurves(curves=filterByBoolMask_3.in)
byPatch_4 = Surface.ByPatch(closedCurve=byJoinedCurves_2)
thicken_2 = Surface.Thicken(surface=byPatch_4)
byUnion_2 = Solid.ByUnion(solids=thicken_2)
intersect_2 = Geometry.Intersect(geometry=byUnion_2, other=byPatch_3)
area_2 = Surface.Area(surface=intersect_2)
cm²_m²_2 = CodeBlock { 10000; }
div_2 = area_2 / cm²_m²_2
sum_2 = Math.Sum(values=div_2)

# group: Location Output
siteLocation = SiteLocation()
name_2 = DynamoUnits.Location.Name(location=siteLocation)

# group: Projected Area Topography
categories_3 = Categories("OST_Topography")
all_elements_of_category_3 = ElementsOfCategory(Category=categories_3)
code_block_11 = CodeBlock { "Material"; }
getParameterValueByName = Element.GetParameterValueByName(element=all_elements_of_category_3, parameterName=code_block_11)
name_3 = Material.Name(material=getParameterValueByName)
string = StringInput("Grass")  # graph input
contains_2 = String.Contains(string=name_3, searchFor=string)
filterByBoolMask_4 = List.FilterByBoolMask(list=all_elements_of_category_3, mask=contains_2)
code_block_12 = CodeBlock { "Projected Area"; }
getParameterValueByName_2 = Element.GetParameterValueByName(element=filterByBoolMask_4.in, parameterName=code_block_12)
niet_verharde_oppervlakte = Math.Sum(values=getParameterValueByName_2)
getParameterValueByName_3 = Element.GetParameterValueByName(element=filterByBoolMask_4.out, parameterName=code_block_12)
verharde_oppervlakte = Math.Sum(values=getParameterValueByName_3)

# group: Export parameters to csv
string_2 = StringInput("\")
file_path = StringInput("C:\Users\simon_w3\OneDrive - UGent\School\Ugent\2de ma ing.-arch\Masterproef\GMasterproef\20230420\Output")  # graph input
file_name = StringInput("test2.csv")  # graph input
join = String.Join(separator=string_2, string0=file_path, string1=file_name)
list_create = List.Create(item0=sum_2, item1=name_2, item2=niet_verharde_oppervlakte, item3=verharde_oppervlakte)
exportCSV = Data.ExportCSV(filePath=join, data=list_create)
