# Dynamo graph dynamo script final.dyn (Dynamo 2.13.1.3887)
# packages: archi-lab.net 2023.213.1722, Rhythm 2023.2.2, JsonData 2.0.2

# group: ID
string = StringInput("B1")
string_2 = StringInput("B2")
string_3 = StringInput("B8")
string_4 = StringInput("B13")
string_5 = StringInput("B14")
string_6 = StringInput("B15")
string_7 = StringInput("B16")

are_all_the_roofs_modelled_as_a = BoolSelector(true)  # "Are all the roofs modelled as a roof?"; graph input

# group: Select green roofs
categories = Categories("OST_Roofs")
all_elements_of_category = ElementsOfCategory(Category=categories)
select_greenroofs = DSModelElementsSelection()  # 1 picked in the model; graph input
if_ = RefactoredIf(test=are_all_the_roofs_modelled_as_a, true=all_elements_of_category, false=select_greenroofs)
getMaterials = Element.GetMaterials(element=if_)
name = Material.Name(material=getMaterials)
green_roof_material = StringInput("")  # graph input
contains = String.Contains(string=name, searchFor=green_roof_material)
anyTrue = List.AnyTrue(list=contains@L2)
filterByBoolMask = List.FilterByBoolMask(list=if_, mask=anyTrue)

string_8 = StringInput("RR_Existing&unconnected")

# group: Filter existing vs new
ʳʰʸᵗʰᵐ_elements = Rhythm.Revit.Elements.Elements.GetParameterValueByNameTypeOrInstance(element=filterByBoolMask.in, parameterName=string_8)
code_block = CodeBlock { 1; }
contains_2 = List.Contains(list=ʳʰʸᵗʰᵐ_elements@L1, item=code_block)
filterByBoolMask_2 = List.FilterByBoolMask(list=filterByBoolMask.in, mask=contains_2)

projectunits = Custom[Projectunits]()

# group: Length
code_block_2 = CodeBlock { 1; }
takeItems = List.TakeItems(list=projectunits.Length, amount=code_block_2)
string_9 = StringInput("Meters")
contains_3 = String.Contains(string=takeItems, searchFor=string_9)
mm²_m² = CodeBlock { 1; }
boolean = BoolSelector(false)
if_2 = RefactoredIf(test=contains_3, true=mm²_m², false=boolean)
string_10 = StringInput("Decimeters")
contains_4 = String.Contains(string=takeItems, searchFor=string_10)
mm²_m²_2 = CodeBlock { 100; }
boolean_2 = BoolSelector(false)
if_3 = RefactoredIf(test=contains_4, true=mm²_m²_2, false=boolean_2)
string_11 = StringInput("Centimeters")
contains_5 = String.Contains(string=takeItems, searchFor=string_11)
mm²_m²_3 = CodeBlock { 10000; }
boolean_3 = BoolSelector(false)
if_4 = RefactoredIf(test=contains_5, true=mm²_m²_3, false=boolean_3)
string_12 = StringInput("Millimeters")
contains_6 = String.Contains(string=takeItems, searchFor=string_12)
mm²_m²_4 = CodeBlock { 1000000; }
boolean_4 = BoolSelector(false)
if_5 = RefactoredIf(test=contains_6, true=mm²_m²_4, false=boolean_4)
list_create = List.Create(item0=if_2, item1=if_3, item2=if_4, item3=if_5)
flatten = List.Flatten(list=list_create)
boolean_5 = BoolSelector(false)
removeItem = archilab.Lists.Lists.RemoveItem(list=flatten, item=boolean_5)

# group: Projected Roof Area - Existing green roof area
code_block_3 = CodeBlock { 1; }
origin = Point.Origin()
code_block_4 = CodeBlock { 900000; }
byCenterPointRadius = Circle.ByCenterPointRadius(centerPoint=origin, radius=code_block_4)
byPatch = Surface.ByPatch(closedCurve=byCenterPointRadius)
geometry = Element.Geometry(element=filterByBoolMask_2.in)
explode = Geometry.Explode(geometry=geometry)
faces = Topology.Faces(topology=explode)
code_block_5 = CodeBlock { 1; }
flatten_2 = List.Flatten(list=faces, amount=code_block_5)
edges = Face.Edges(face=flatten_2)
curveGeometry = Edge.CurveGeometry(edge=edges)
code_block_6 = CodeBlock { 1; }
flatten_3 = List.Flatten(list=curveGeometry, amount=code_block_6)
ZAxis = Vector.ZAxis()
reverse = Vector.Reverse(vector=ZAxis)
projectInputOnto = Surface.ProjectInputOnto(surface=byPatch, geometryToProject=flatten_3, projectionDirection=reverse)
flatten_4 = List.Flatten()  # unwired: list
map = List.Map(list=projectInputOnto, function=flatten_4)
code_block_7 = CodeBlock { null; }
eq = map == code_block_7
anyTrue_2 = List.AnyTrue(list=eq, lacing=CrossProduct)
not_ = Not(x=anyTrue_2)
filterByBoolMask_3 = List.FilterByBoolMask(list=map, mask=not_)
byJoinedCurves = PolyCurve.ByJoinedCurves(curves=filterByBoolMask_3.in)
byPatch_2 = Surface.ByPatch(closedCurve=byJoinedCurves)
thicken = Surface.Thicken(surface=byPatch_2)
byUnion = Solid.ByUnion(solids=thicken)
intersect = Geometry.Intersect(geometry=byUnion, other=byPatch)
area = Surface.Area(surface=intersect)
div = area / removeItem
sum = Math.Sum(values=div)

# group: Projected Roof Area - New green roof area
code_block_8 = CodeBlock { 1; }
origin_2 = Point.Origin()
code_block_9 = CodeBlock { 900000; }
byCenterPointRadius_2 = Circle.ByCenterPointRadius(centerPoint=origin_2, radius=code_block_9)
byPatch_3 = Surface.ByPatch(closedCurve=byCenterPointRadius_2)
geometry_2 = Element.Geometry(element=filterByBoolMask_2.out)
explode_2 = Geometry.Explode(geometry=geometry_2)
faces_2 = Topology.Faces(topology=explode_2)
code_block_10 = CodeBlock { 1; }
flatten_5 = List.Flatten(list=faces_2, amount=code_block_10)
edges_2 = Face.Edges(face=flatten_5)
curveGeometry_2 = Edge.CurveGeometry(edge=edges_2)
code_block_11 = CodeBlock { 1; }
flatten_6 = List.Flatten(list=curveGeometry_2, amount=code_block_11)
ZAxis_2 = Vector.ZAxis()
reverse_2 = Vector.Reverse(vector=ZAxis_2)
projectInputOnto_2 = Surface.ProjectInputOnto(surface=byPatch_3, geometryToProject=flatten_6, projectionDirection=reverse_2)
flatten_7 = List.Flatten()  # unwired: list
map_2 = List.Map(list=projectInputOnto_2, function=flatten_7)
code_block_12 = CodeBlock { null; }
eq_2 = map_2 == code_block_12
anyTrue_3 = List.AnyTrue(list=eq_2, lacing=CrossProduct)
not_2 = Not(x=anyTrue_3)
filterByBoolMask_4 = List.FilterByBoolMask(list=map_2, mask=not_2)
byJoinedCurves_2 = PolyCurve.ByJoinedCurves(curves=filterByBoolMask_4.in)
byPatch_4 = Surface.ByPatch(closedCurve=byJoinedCurves_2)
thicken_2 = Surface.Thicken(surface=byPatch_4)
byUnion_2 = Solid.ByUnion(solids=thicken_2)
intersect_2 = Geometry.Intersect(geometry=byUnion_2, other=byPatch_3)
area_2 = Surface.Area(surface=intersect_2)
div_2 = area_2 / removeItem
sum_2 = Math.Sum(values=div_2)

# group: If null, return 0
isNull = Object.IsNull(object=sum_2)
code_block_13 = CodeBlock { 0; }
if_6 = RefactoredIf(test=isNull, true=code_block_13, false=sum_2)

# group: If null, return 0
isNull_2 = Object.IsNull(object=sum)
code_block_14 = CodeBlock { 0; }
if_7 = RefactoredIf(test=isNull_2, true=code_block_14, false=sum)

# group: Select roofs
categories_2 = Categories("OST_Roofs")
all_elements_of_category_2 = ElementsOfCategory(Category=categories_2)
select_roofs = DSModelElementsSelection()  # 2 picked in the model; graph input
if_8 = RefactoredIf(test=are_all_the_roofs_modelled_as_a, true=all_elements_of_category_2, false=select_roofs)

# group: Filter existing vs new
ʳʰʸᵗʰᵐ_elements_2 = Rhythm.Revit.Elements.Elements.GetParameterValueByNameTypeOrInstance(element=if_8, parameterName=string_8)
code_block_15 = CodeBlock { 1; }
contains_7 = List.Contains(list=ʳʰʸᵗʰᵐ_elements_2@L1, item=code_block_15)
filterByBoolMask_5 = List.FilterByBoolMask(list=if_8, mask=contains_7)

# group: Projected Roof Area - Existing total roof area
code_block_16 = CodeBlock { 1; }
cm²_m² = CodeBlock { 1000000; }
origin_3 = Point.Origin()
code_block_17 = CodeBlock { 400000; }
byCenterPointRadius_3 = Circle.ByCenterPointRadius(centerPoint=origin_3, radius=code_block_17)
byPatch_5 = Surface.ByPatch(closedCurve=byCenterPointRadius_3)
geometry_3 = Element.Geometry(element=filterByBoolMask_5.in)
explode_3 = Geometry.Explode(geometry=geometry_3)
faces_3 = Topology.Faces(topology=explode_3)
code_block_18 = CodeBlock { 1; }
flatten_8 = List.Flatten(list=faces_3, amount=code_block_18)
edges_3 = Face.Edges(face=flatten_8)
curveGeometry_3 = Edge.CurveGeometry(edge=edges_3)
code_block_19 = CodeBlock { 1; }
flatten_9 = List.Flatten(list=curveGeometry_3, amount=code_block_19)
ZAxis_3 = Vector.ZAxis()
reverse_3 = Vector.Reverse(vector=ZAxis_3)
projectInputOnto_3 = Surface.ProjectInputOnto(surface=byPatch_5, geometryToProject=flatten_9, projectionDirection=reverse_3)
flatten_10 = List.Flatten()  # unwired: list
map_3 = List.Map(list=projectInputOnto_3, function=flatten_10)
code_block_20 = CodeBlock { null; }
eq_3 = map_3 == code_block_20
anyTrue_4 = List.AnyTrue(list=eq_3, lacing=CrossProduct)
not_3 = Not(x=anyTrue_4)
filterByBoolMask_6 = List.FilterByBoolMask(list=map_3, mask=not_3)
byJoinedCurves_3 = PolyCurve.ByJoinedCurves(curves=filterByBoolMask_6.in)
byPatch_6 = Surface.ByPatch(closedCurve=byJoinedCurves_3)
thicken_3 = Surface.Thicken(surface=byPatch_6)
byUnion_3 = Solid.ByUnion(solids=thicken_3)
intersect_3 = Geometry.Intersect(geometry=byUnion_3, other=byPatch_5)
area_3 = Surface.Area(surface=intersect_3)
div_3 = area_3 / removeItem
sum_3 = Math.Sum(values=div_3)

# group: Projected Roof Area - New total roof area
code_block_21 = CodeBlock { 1; }
origin_4 = Point.Origin()
code_block_22 = CodeBlock { 400000; }
byCenterPointRadius_4 = Circle.ByCenterPointRadius(centerPoint=origin_4, radius=code_block_22)
byPatch_7 = Surface.ByPatch(closedCurve=byCenterPointRadius_4)
geometry_4 = Element.Geometry(element=filterByBoolMask_5.out)
explode_4 = Geometry.Explode(geometry=geometry_4)
faces_4 = Topology.Faces(topology=explode_4)
code_block_23 = CodeBlock { 1; }
flatten_11 = List.Flatten(list=faces_4, amount=code_block_23)
edges_4 = Face.Edges(face=flatten_11)
curveGeometry_4 = Edge.CurveGeometry(edge=edges_4)
code_block_24 = CodeBlock { 1; }
flatten_12 = List.Flatten(list=curveGeometry_4, amount=code_block_24)
ZAxis_4 = Vector.ZAxis()
reverse_4 = Vector.Reverse(vector=ZAxis_4)
projectInputOnto_4 = Surface.ProjectInputOnto(surface=byPatch_7, geometryToProject=flatten_12, projectionDirection=reverse_4)
flatten_13 = List.Flatten()  # unwired: list
map_4 = List.Map(list=projectInputOnto_4, function=flatten_13)
code_block_25 = CodeBlock { null; }
eq_4 = map_4 == code_block_25
anyTrue_5 = List.AnyTrue(list=eq_4, lacing=CrossProduct)
not_4 = Not(x=anyTrue_5)
filterByBoolMask_7 = List.FilterByBoolMask(list=map_4, mask=not_4)
byJoinedCurves_4 = PolyCurve.ByJoinedCurves(curves=filterByBoolMask_7.in)
byPatch_8 = Surface.ByPatch(closedCurve=byJoinedCurves_4)
thicken_4 = Surface.Thicken(surface=byPatch_8)
byUnion_4 = Solid.ByUnion(solids=thicken_4)
intersect_4 = Geometry.Intersect(geometry=byUnion_4, other=byPatch_7)
area_4 = Surface.Area(surface=intersect_4)
div_4 = area_4 / removeItem
sum_4 = Math.Sum(values=div_4)

# group: If null, return 0
isNull_3 = Object.IsNull(object=sum_4)
code_block_26 = CodeBlock { 0; }
if_9 = RefactoredIf(test=isNull_3, true=code_block_26, false=sum_4)

# group: If null, return 0
isNull_4 = Object.IsNull(object=sum_3)
code_block_27 = CodeBlock { 0; }
if_10 = RefactoredIf(test=isNull_4, true=code_block_27, false=sum_3)

# group: Value calculations
add = if_6 + if_7
add_2 = if_9 + if_10
code_block_28 = CodeBlock { 2; }
div_5 = if_6 / code_block_28
sub = if_9 - div_5
code_block_29 = CodeBlock { 2; }
div_6 = if_7 / code_block_29
sub_2 = if_10 - div_6

# group: Location Output
siteLocation = SiteLocation()
name_2 = DynamoUnits.Location.Name(location=siteLocation)

# group: Get toposurfaces
are_all_the_toposurfaces = BoolSelector(true)  # "Are all the toposurfaces modelled as toposurfaces?"; graph input
categories_3 = Categories("OST_Topography")
all_elements_of_category_3 = ElementsOfCategory(Category=categories_3)
select_greenroofs_2 = DSModelElementsSelection()  # 2 picked in the model; graph input
if_11 = RefactoredIf(test=are_all_the_toposurfaces, true=all_elements_of_category_3, false=select_greenroofs_2)
material_name = StringInput("")  # graph input

# group: Filter existing vs new
ʳʰʸᵗʰᵐ_elements_3 = Rhythm.Revit.Elements.Elements.GetParameterValueByNameTypeOrInstance(element=if_11, parameterName=string_8)
code_block_30 = CodeBlock { 1; }
contains_8 = List.Contains(list=ʳʰʸᵗʰᵐ_elements_3@L1, item=code_block_30)
filterByBoolMask_8 = List.FilterByBoolMask(list=if_11, mask=contains_8)

# group: Area
code_block_31 = CodeBlock { 1; }
takeItems_2 = List.TakeItems(list=projectunits.Area, amount=code_block_31)
string_13 = StringInput("Square meters")
contains_9 = String.Contains(string=takeItems_2, searchFor=string_13)
mm²_m²_5 = CodeBlock { 1; }
boolean_6 = BoolSelector(false)
if_12 = RefactoredIf(test=contains_9, true=mm²_m²_5, false=boolean_6)
string_14 = StringInput("Square decimeters")
contains_10 = String.Contains(string=takeItems_2, searchFor=string_14)
mm²_m²_6 = CodeBlock { 1000; }
boolean_7 = BoolSelector(false)
if_13 = RefactoredIf(test=contains_10, true=mm²_m²_6, false=boolean_7)
string_15 = StringInput("Square centimeters")
contains_11 = String.Contains(string=takeItems_2, searchFor=string_15)
mm²_m²_7 = CodeBlock { 1000000; }
boolean_8 = BoolSelector(false)
if_14 = RefactoredIf(test=contains_11, true=mm²_m²_7, false=boolean_8)
string_16 = StringInput("Square millimeters")
contains_12 = String.Contains(string=takeItems_2, searchFor=string_16)
mm²_m²_8 = CodeBlock { 1000000000; }
boolean_9 = BoolSelector(false)
if_15 = RefactoredIf(test=contains_12, true=mm²_m²_8, false=boolean_9)
list_create_2 = List.Create(item0=if_12, item1=if_13, item2=if_14, item3=if_15)
flatten_14 = List.Flatten(list=list_create_2)
boolean_10 = BoolSelector(false)
removeItem_2 = archilab.Lists.Lists.RemoveItem(list=flatten_14, item=boolean_10)

# group: Projected Area Topography - New
code_block_32 = CodeBlock { "Material"; }
getParameterValueByName = Element.GetParameterValueByName(element=filterByBoolMask_8.out, parameterName=code_block_32)
code_block_33 = CodeBlock { "<By Category>"; }
removeItem_3 = archilab.Lists.Lists.RemoveItem(list=getParameterValueByName, item=code_block_33)
name_3 = Material.Name(material=removeItem_3)
contains_13 = String.Contains(string=name_3, searchFor=material_name)
filterByBoolMask_9 = List.FilterByBoolMask(list=filterByBoolMask_8.out, mask=contains_13)
code_block_34 = CodeBlock { "Projected Area"; }
getParameterValueByName_2 = Element.GetParameterValueByName(element=filterByBoolMask_9.out, parameterName=code_block_34)
verharde_oppervlakte = Math.Sum(values=getParameterValueByName_2)
div_7 = verharde_oppervlakte / removeItem_2

# group: Projected Area Topography - Existing
code_block_35 = CodeBlock { "Material"; }
getParameterValueByName_3 = Element.GetParameterValueByName(element=filterByBoolMask_8.in, parameterName=code_block_35)
code_block_36 = CodeBlock { "<By Category>"; }
removeItem_4 = archilab.Lists.Lists.RemoveItem(list=getParameterValueByName_3, item=code_block_36)
name_4 = Material.Name(material=removeItem_4)
contains_14 = String.Contains(string=name_4, searchFor=material_name)
filterByBoolMask_10 = List.FilterByBoolMask(list=filterByBoolMask_8.in, mask=contains_14)
code_block_37 = CodeBlock { "Projected Area"; }
getParameterValueByName_4 = Element.GetParameterValueByName(element=filterByBoolMask_10.out, parameterName=code_block_37)
verharde_oppervlakte_2 = Math.Sum(values=getParameterValueByName_4)
div_8 = verharde_oppervlakte_2 / removeItem_2

# group: Export to JSON
keys = List.Create(item0=string, item1=string_2, item2=string_3, item3=string_4, item4=string_5, item5=string_6, item6=string_7)
values = List.Create(item0=add, item1=add_2, item2=name_2, item3=div_7, item4=div_8, item5=sub, item6=sub_2)
byKeysValues = DesignScript.Builtin.Dictionary.ByKeysValues(keys=keys, values=values)
byDictionary = JsonData.Elements.JsonObject.ByDictionary(dictionary=byKeysValues)
string_17 = StringInput("\")
file_path = StringInput("")  # graph input
file_name = StringInput("")  # graph input
join = String.Join(separator=string_17, string0=file_path, string1=file_name)
toJsonFile = JsonData.Utilities.Write.ToJsonFile(jsonObjects=byDictionary, filepath=join)
