# Dynamo graph test json.dyn (Dynamo 2.13.1.3887)
# packages: JsonData 2.0.2

code_block = CodeBlock { "A"; }
code_block_2 = CodeBlock { "B"; }
list_create = List.Create(item0=code_block, item1=code_block_2)
categories = Categories("OST_Roofs")
all_elements_of_category = ElementsOfCategory(Category=categories)
code_block_3 = CodeBlock { "Area"; }
getParameterValueByName = Element.GetParameterValueByName(element=all_elements_of_category, parameterName=code_block_3)
byKeysValues = DesignScript.Builtin.Dictionary.ByKeysValues(keys=list_create, values=getParameterValueByName)
byDictionary = JsonData.Elements.JsonObject.ByDictionary(dictionary=byKeysValues)
string = StringInput("C:\Users\simon_w3\OneDrive - UGent\School\Ugent\2de ma ing.-arch\Masterproef\Illustraties\test.json")
toJsonFile = JsonData.Utilities.Write.ToJsonFile(jsonObjects=byDictionary, filepath=string)
